# Grasshopper definition Mass_Generator.ghx (Grasshopper 1.0.8)
# plug-ins: RhinoCodePluginGH

panel = Panel("""4
6
9""")
panel_2 = Panel("""0.4
0.3
0.3""")
panel_3 = Panel("""10
45""")
panel_4 = Panel("""1
0.5""")
pt = Point(Point(7.372175731, 3.889070445, 0))
python = GhPythonScript(pts=pt, area="3000", shares=panel_2, ratios=panel_4, n_ceilings=panel, rotations=panel_3, divide_area=Toggle(False))  # -> out, x_dimensions, y_dimensions, buildings; inputs pts: list of Plane, shares: list, ratios: list, n_ceilings: list of Int32, rotations: list, divide_area: Boolean
# ---------- python: Python ----------
import Rhino.Geometry as rg
import math
import ghpythonlib.treehelpers as gt


class Dimensions:
    def __init__(self, area, ratio):
        self.area = area
        self.ratio = ratio
        self.x = math.sqrt(area / ratio)
        self.y = area / self.x

    def __str__(self):
        return "Dimensions(area={}, ratio={}, x={}, y={})".format(self.area, self.ratio, self.x, self.y)

for r in ratios:
    if r > 1 or r <= 0:
        raise ValueError("ratio can be changed from 0 < ratio <= 1")
if len(pts) == 1:
    area_list = [area]
    ratios = [ratios[0]]
    n_ceilings = [n_ceilings[0]]
    rotations = [rotations[0]]
else:
    a = sum(shares)
    area_list = []
    if divide_area:
        if sum(shares) != 1 and not abs(sum(shares) - 1) < 0.1 ** 10:
            raise ValueError("the sum of shares must equal to 1")
        if len(pts) != len(shares):
            raise ValueError("you provided {} pts but {} shares. the length of them must be equal".format(len(pts), len(shares)))
        for i in shares:
            area_list.append(area * i)
    else:
        for i in pts:
            area_list.append(area)
    while len(ratios) < len(pts):
        ratios.append(ratios[-1])
    while len(n_ceilings) < len(pts):
        n_ceilings.append(n_ceilings[-1])
    while len(rotations) < len(pts):
        rotations.append(rotations[-1])


zones = []
x_dims = []
y_dims = []
for i in range(len(pts)):
    dims = Dimensions( area_list[i] / n_ceilings[i] , ratios[i] )
    x = dims.x
    y = dims.y
    x_dims.append(x)
    y_dims.append(y)
    x_interval = rg.Interval(-x/2 , x/2)
    y_interval = rg.Interval(-y/2 , y/2)
    temp_zones = []
    pts[i].Rotate(math.radians(rotations[i]) , rg.Vector3d.ZAxis)
    for j in range(n_ceilings[i]):
        box = rg.Box(pts[i], x_interval , y_interval , rg.Interval(0+(j*3) , 3 * (j+1)))
        box = rg.Box.ToBrep(box)
        temp_zones.append(box)
    zones.append(temp_zones)

for i in range(len(zones)-1):
    for j in range(i+1, len(zones)):
        if len(rg.Intersect.Intersection.BrepBrep(zones[i][0], zones[j][0], 0.01)[1]) != 0:
            raise ValueError("Buildings {} and {} intersect".format(i, j))

x_dimensions = x_dims
y_dimensions = y_dims
buildings = gt.list_to_tree(zones)
# ---------- end python ----------
pt_2 = Point(Point(-1.946324085, 3.343882538, 0))
S = Script(
    plane=pt_2,
    area="1000",
    ratio=Slider(0.4, range=0..1),
    rotation=Slider(-0.71, range=-5..5),
    n_ceiling=Slider(5, range=0..100))  # -> out, a, b, zones; inputs plane: Plane, area: Double, ratio: Double, rotation: Double, n_ceiling: Int32
# ---------- S: C# ----------
// Grasshopper Script Instance
using System;
using System.Collections;
using System.Collections.Generic;
using System.Drawing;

using Rhino;
using Rhino.Geometry;

using Grasshopper;
using Grasshopper.Kernel;
using Grasshopper.Kernel.Data;
using Grasshopper.Kernel.Types;

public class Script_Instance : GH_ScriptInstance
{
  
    private void RunScript(
	Plane plane,
	double area,
	double ratio,
	double rotation,
	int n_ceiling,
	ref object a,
	ref object b,
	ref object zones)

    {
    if (Math.Abs(rotation) > Math.PI/2)
    {
        this.Component.AddRuntimeMessage(GH_RuntimeMessageLevel.Error, "Rotation angle exceeds π (pi).");
        return; // Exit the script to prevent further execution
    }

        Plane ref_plane = plane;
        ref_plane.Rotate(rotation , Vector3d.ZAxis);
        BoxInfo zone_attr = CalculateBoxDimentions (area , ratio , 3);
        Interval[] intervals = zone_attr.Intervals ;

        Brep[] building = new Brep[n_ceiling];
        
        for (int i = 0 ; i < n_ceiling ; i++ )
        {
            building[i] = new Box(ref_plane , intervals[0] , intervals[1] , new Interval(3 * i , 3 * (i+1) )).ToBrep() ;
        }

        zones = building;
        b = ToDegree(rotation);

    }



    public class BoxInfo
    {
        public double[] Dimensions {get; set; }
        public Interval[] Intervals {get; set; }

    }

    public BoxInfo CalculateBoxDimentions (double area , double ratio , double height)
    {
        double[] dimensions = new double[3];

        double x_Dim = Math.Sqrt(area / ratio);
        double y_Dim = area / x_Dim;
        double z_Dim = height;
        dimensions[0] = x_Dim;
        dimensions[1] = y_Dim;
        dimensions[2] = z_Dim;

        Interval[] intervals = new Interval[2];
        Interval x_interval = new Interval(-x_Dim/2 , x_Dim/2);
        Interval y_interval = new Interval(-y_Dim/2 , y_Dim/2);

        intervals[0] = x_interval;
        intervals[1] = y_interval;

        BoxInfo boxInfo = new BoxInfo
        {
            Dimensions = dimensions,
            Intervals = intervals

        };

        return boxInfo;
        
    }

    public double ToDegree(double radians)
    {
        double degree = (180.0 / Math.PI) * radians;
        return degree;
    }

    public double ToRadian(double degrees)
    {
        double radian = (Math.PI / 180.0) * degrees;
        return radian;
    }

}
# ---------- end S ----------
panel_5 = Panel(S.a)
panel_6 = Panel(S.zones)
